vi "PackageDetails.gviweb"   [LabVIEW NXG Preview 4.0.0]
panel controls:
  "Download": bool
panel indicators:
  "URL Image": string
  "Name": string
  "PkgIcon": string
  "ReleaseDate": string
  "Vendor": string
  "Author": string
  "Copyright": string
  "Description": string
  "Release Notes": string
  "Dependencies": string
  "Version": string
  "PrototypedBy": string
types:
  "Package Version.gtype" = cluster{"Version Number": "Version Number--cluster.gtype", "Version Text": string, "ReleaseDate": string, "DisplayName": string, "Description": string, "Summary": string, "Copyright": string, "Vendor": string, "Author": string, "Release Notes": string, "Dependencies": string[], "IconURL": string, "PackageURL": string}
  T1 = cluster{"BaseURL": string, "Package Details": "Package Version.gtype"}
uses:
  QMH support::Message Queue::Create All Message Queues.gviweb
  HTTP Client API::Base URL--constant.gvi
  QMH support::Message Queue::Dequeue Message.gviweb
  QMH support::Message Queue::Enqueue Message (Single).gviweb
  BusyStateAPI::BusyStateAPI.jsli::SetBusy
  HTTP Client API::Connection::Open Connection.gvi
  HTTP Client API::Packages::Get Package Details.gvi
  HTTP Client API::Connection::Close Connection.gvi
  BusyStateAPI::BusyStateAPI.jsli::UnsetBusy
  WebApp::Support::JSON Timestamp to Display.gvi
  WebApp::Support::Join Strings.gvi
  RedirectURL::Redirect.jsli::Redirect
  NI::G Core::Error::Read Error Code.gvi
  Error Handling::Error Handler.gvi
  NI::G Core::Error::Build Error Cluster.gvi
  QMH support::Error Handler - Message Handling Loop.gviweb
  QMH support::Error Handler - Event Handling Loop.gviweb
diagram:
  w1 = bool TRUE  # Stop Event
  Create User Event[EventName="Stop Event"](user event data type=w1) -> (error out=w2, user event out=w3)
  call "Create All Message Queues.gviweb"(error in=w2) -> (message queues=w4, error out=w5)
  call "Base URL--constant.gvi"() -> (Base URL=w6)
  Property Node(instance in=T1 {all zero or empty}, "BaseURL"=w6) -> (instance out=w7)
  Property Node(instance in=w4) -> ("UI"=w8)
  s1 = w7  # shift register
  while {
    call "Dequeue Message.gviweb"(message queue in=w8, error in=w5) -> (message queue out=w9, message=w10, message data=w11, error out=w12)
    # s1: Data
    # w3: Stop Event
    case (w10) ignore case {  # Message Cases
      frame "Initialize" {
        call "Enqueue Message (Single).gviweb"(message queue in=w9, message="Get Package Details", error in=w12) -> (error out=w13)
        w14 = s1
        w15 = default
      }
      frame "Get Package Details" {
        Property Node(instance in=s1) -> ("BaseURL"=w16, instance out=w17)
        call "SetBusy"(error in=w12) -> (error out=w18)
        call "Open Connection.gvi"(Root URL=w16, error in=w18) -> (Connection=w19, error out=w20)
        call "Get Package Details.gvi"(Connection in=w19, error in=w20) -> (Connection out=w21, Package Details=w22, error out=w23)
        Property Node(instance in=w17, "Package Details"=w22) -> (instance out=w14)
        call "Close Connection.gvi"(Connection in=w21, error in=w23) -> (error out=w24)
        call "UnsetBusy"(error in=w24) -> (error out=w25)
        call "Enqueue Message (Single).gviweb"(message queue in=w9, message="Display Package Details", error in=w25) -> (error out=w13)
        w15 = default
      }
      frame "Display Package Details" {
        Property Node(instance in=s1) -> ("Package Details"=w26, instance out=w14)
        Property Node(instance in=w26) -> ("DisplayName"=w27, "Version Text"=w28, "IconURL"=w29, "ReleaseDate"=w30, "Vendor"=w31, "Author"=w32, "Copyright"=w33, "Description"=w34, "Release Notes"=w35, "Dependencies"=w36)
        $Name <- w27
        $Version <- w28
        $PkgIcon <- w29
        call "JSON Timestamp to Display.gvi"(JSON Timestamp=w30) -> (Display Timestamp=w37)
        $ReleaseDate <- w37
        $Vendor <- w31
        $Author <- w32
        $Copyright <- w33
        $Description <- w34
        $"Release Notes" <- w35
        call "Join Strings.gvi"(String Array Input=w36, Separator="\r\n") -> (String output=w38)
        $Dependencies <- w38
        w13 = w12
        w15 = default
      }
      frame "Download Package" {
        Property Node(instance in=s1) -> ("Package Details:PackageURL"=w39, instance out=w14)
        call "SetBusy"(error in=w12) -> (error out=w40)
        call "Redirect"(URL=w39, target="_blank", error in=w40) -> (error out=w41)
        call "UnsetBusy"(error in=w41) -> (error out=w13)
        w15 = default
      }
      frame "Error" {
        # Process Error
        w42 = no error  # Error
        Unflatten From JSON(JSON string=w11, error in (no error)=w12, type and defaults=w42) -> (error out=w13, value=w43)
        call "Read Error Code.gvi"(error in=w43) -> (code=w44)
        case (w44) {
          frame 501401 {
            # Redirect to Login page
            call "Redirect"(URL="Login.html")
          }
          frame 0, Default {
            # Display Error
            call "Error Handler.gvi"(error in=w43)
          }
        }
        w14 = s1
        w15 = default
      }
      frame "---Copy This Frame---" {
        Merge Errors(w12) -> (error out=w13)
        w14 = s1
        w15 = default
      }
      frame "Exit" {
        # Release the message queue reference
        Release Queue(error in=w12, queue=w9) -> (error out=w45)
        Generate User Event(event data=TRUE, user event=w3) -> (error out=w46)
        Merge Errors(w46, w45) -> (error out=w13)
        # Stop the VI
        w14 = s1
        w15 = TRUE
      }
      frame Default {
        w47 = "The invalid message string \"%s\" was received in the Message Handling Loop."
        Format Into String(formatString=w47, w10) -> w48
        call "Build Error Cluster.gvi"(code=1, description=w48) -> (error out=w13)
        w14 = s1
        w15 = default
      }
    }
    call "Error Handler - Message Handling Loop.gviweb"(message queue in=w9, error in=w13) -> (dup error in=w49)
    next s1 = w14
    stop if w15
  }
  Register For Events("Stop Event"=w3) -> (event registration refnum out=w50)
  s2 = w50  # shift register
  while {
    event (dynamic events = s2) {
      on "Dynamic" Stop Event {
        # The Message Handling Loop processed an "Exit" message, which fired this event to stop the Event Handling Loop.
        w51 = TRUE
        w52 = no error
        w53 = w8
      }
      on "Download" Value changed {
        call "Enqueue Message (Single).gviweb"(message queue in=w8, message="Download Package") -> (message queue out=w53, error out=w52)
        w51 = default
      }
    }
    call "Error Handler - Event Handling Loop.gviweb"(message queue in=w53, error in=w52) -> (dup error in=w54)
    stop if w51
  }
  Unregister For Events(error in=w54, event registration refnum=s2) -> (error out=w55)
  Merge Errors(w55, w49) -> (error out=w56)
  Destroy User Event(error in=w56, user event=w3)
