vi "Packages.gviweb"   [LabVIEW NXG Preview 4.0.0]
# This template is for the Queued Message Handler design pattern. The Event Handling Loop generates messages based on user interface actions. The Message Handling Loop processes messages generated by the Event Handling Loop, or by other messages. The messages are string values, so new messages can be added easily to the Message Cases case structure in the Message Handling Loop. Each message cluster can also provide an optional value for Message Data,  which is a String that can be swapped to whatever type of data is required.
panel controls:
  "Search": string
  "First": bool
  "Previous": bool
  "Next": bool
  "Last": bool
  "Package Details": bool
  "Package Details_2": bool
panel indicators:
  "Tree": cluster{"Element 0": string, "Data": string}[]
  "Status string": string
  "URL Image": string
types:
  "List Packages Settings--cluster.gtype" = cluster{"PageNumber": i32, "SearchCriteria": string}
  "List Details--cluster.gtype" = cluster{"TotalPackages": i32, "TotalPages": i32, "PagesBefore": i32, "PagesAfter": i32, "ItemsPerPage": i32}
  "Package--cluster.gtype" = cluster{"Name": string, "DisplayName": string, "RepoType": string, "RepoName": string, "Versions": "Package Version.gtype"[]}
  T1 = cluster{"BaseURL": string, "Settings": "List Packages Settings--cluster.gtype", "List Details": "List Details--cluster.gtype", "Packages": "Package--cluster.gtype"[], "All Tags": string[], "All Indexes": cluster{"Package": i32, "Version": i32}[]}
uses:
  QMH support::Message Queue::Create All Message Queues.gviweb
  HTTP Client API::Base URL--constant.gvi
  QMH support::Message Queue::Dequeue Message.gviweb
  QMH support::Message Queue::Enqueue Message (Single).gviweb
  BusyStateAPI::BusyStateAPI.jsli::SetBusy
  HTTP Client API::Connection::Open Connection.gvi
  HTTP Client API::Packages::List Packages.gvi
  HTTP Client API::Connection::Close Connection.gvi
  BusyStateAPI::BusyStateAPI.jsli::UnsetBusy
  RedirectURL::Redirect.jsli::Redirect
  WebApp::Support::Format Packages for Tree Display.gvi
  WebApp::Support::Build Status String.gvi
  HTTP Client API::Packages::Set Package.gvi
  NI::G Core::Error::Read Error Code.gvi
  Error Handling::Error Handler.gvi
  NI::G Core::Error::Build Error Cluster.gvi
  QMH support::Error Handler - Message Handling Loop.gviweb
  QMH support::Error Handler - Event Handling Loop.gviweb
diagram:
  w1 = bool TRUE  # Stop Event
  Create User Event[EventName="Stop Event"](user event data type=w1) -> (error out=w2, user event out=w3)
  call "Create All Message Queues.gviweb"(error in=w2) -> (message queues=w4, error out=w5)
  call "Base URL--constant.gvi"() -> (Base URL=w6)
  w7 = T1 {"Settings"={"PageNumber"=1, "SearchCriteria"=""}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}
  Property Node(instance in=w7, "BaseURL"=w6) -> (instance out=w8)
  Property Node(instance in=w4) -> ("UI"=w9)
  s1 = w8  # shift register
  while {
    call "Dequeue Message.gviweb"(message queue in=w9, error in=w5) -> (message queue out=w10, message=w11, message data=w12, error out=w13)
    # s1: Data
    # w3: Stop Event
    case (w11) ignore case {  # Message Cases
      frame "Initialize" {
        Property Node(instance in=reference to "Tree", "ColumnHeaders"=["Name - Version", "Release Date", "Vendor"])
        w17 = "List Packages Settings--cluster.gtype" {"PageNumber"=1, "SearchCriteria"=""}
        Flatten To JSON(anything=w17, error in (no error)=w13) -> (JSON string=w18, error out=w19)
        call "Enqueue Message (Single).gviweb"(message queue in=w10, message="List Packages", message data=w18, error in=w19) -> (error out=w14)
        w15 = s1
        w16 = default
      }
      frame "List Packages" {
        Property Node(instance in=s1) -> ("BaseURL"=w20, instance out=w21)
        w22 = "List Packages Settings--cluster.gtype" {"PageNumber"=1, "SearchCriteria"=""}
        Unflatten From JSON(JSON string=w12, type and defaults=w22) -> (value=w23)
        Property Node(instance in=w23) -> ("PageNumber"=w24, "SearchCriteria"=w25, instance out=w26)
        call "SetBusy"(error in=w13) -> (error out=w27)
        call "Open Connection.gvi"(Root URL=w20, error in=w27) -> (Connection=w28, error out=w29)
        call "List Packages.gvi"(Connection in=w28, PageNumber=w24, SearchCriteria=w25, error in=w29) -> (Connection out=w30, Packages=w31, List Details=w32, error out=w33)
        Property Node(instance in=w21, "Packages"=w31, "List Details"=w32, "Settings"=w26) -> (instance out=w15)
        call "Close Connection.gvi"(Connection in=w30, error in=w33) -> (error out=w34)
        call "UnsetBusy"(error in=w34) -> (error out=w35)
        call "Enqueue Message (Single).gviweb"(message queue in=w10, message="Display Packages List", error in=w35) -> (error out=w14)
        w16 = default
      }
      frame "TestRedirect" {
        call "Redirect"(URL="http://www.google.ca", error in=w13) -> (error out=w14)
        w15 = s1
        w16 = default
      }
      frame "Display Packages List" {
        Property Node(instance in=s1) -> ("Packages"=w36, instance out=w37)
        call "SetBusy"(error in=w13) -> (error out=w38)
        call "Format Packages for Tree Display.gvi"(Packages=w36, error in=w38) -> (Packages Tree=w39, All Tags=w40, All Indexes=w41, error out=w42)
        $Tree <- w39
        Property Node(instance in=w37, "All Tags"=w40, "All Indexes"=w41) -> (instance out=w15)
        call "UnsetBusy"(error in=w42) -> (error out=w43)
        call "Enqueue Message (Single).gviweb"(message queue in=w10, message="Refresh Controls", error in=w43) -> (error out=w14)
        w16 = default
      }
      frame "Refresh Controls" {
        Build Array(reference to "First", reference to "Previous", reference to "Next", reference to "Last") -> w44
        Property Node(instance in=s1) -> ("List Details:PagesBefore"=w45, "List Details:PagesAfter"=w46, "Settings"=w47, "List Details"=w48, instance out=w15)
        Is Equal To 0(x=w45) -> w49
        case (w49) {
          frame False, Default {
            w50 = FALSE
            w51 = FALSE
          }
          frame True {
            w50 = TRUE
            w51 = TRUE
          }
        }
        Is Equal To 0(x=w46) -> w52
        case (w52) {
          frame False, Default {
            w53 = FALSE
            w54 = FALSE
          }
          frame True {
            w53 = TRUE
            w54 = TRUE
          }
        }
        Build Array(w50, w51, w53, w54) -> w55
        for {
          w56 = each element of w55
          w57 = each element of w44
          Property Node(instance in=w57, "Disabled"=w56)
        }
        call "Build Status String.gvi"(List Packages Settings=w47, List Details=w48) -> (Status String=w58)
        $"Status string" <- w58
        Property Node(instance in=reference to "Tree") -> ("SelectedData"=w59)
        Property Node(instance in=w59) -> ("Element 0"=w60)
        Match Pattern(regular expression="\\\\", string=w60) -> (offset past match=w61)
        Is Greater Or Equal To 0(x=w61) -> w62
        Not(x=w62) -> w63
        Property Node(instance in=reference to "Package Details", "Disabled"=w63)
        Property Node(instance in=reference to "Package Details_2", "Disabled"=w63)
        w14 = w13
        w16 = default
      }
      frame "Show Package Details" {
        call "SetBusy"(error in=w13) -> (error out=w64)
        Property Node(instance in=s1) -> ("BaseURL"=w65, "Packages"=w66, "All Indexes"=w67, "All Tags"=w68, instance out=w15)
        call "Open Connection.gvi"(Root URL=w65, error in=w64) -> (Connection=w69, error out=w70)
        Property Node(instance in=reference to "Tree") -> ("SelectedData"=w71)
        Property Node(instance in=w71) -> ("Element 0"=w72)
        Search 1D Array(1D array=w68, element=w72) -> (index of element=w73)
        Array Index(array=w67) -> (out0[w73]=w74)
        Property Node(instance in=w74) -> ("Package"=w75, "Version"=w76)
        Array Index(array=w66) -> (out0[w75]=w77)
        Property Node(instance in=w77) -> ("Name"=w78, "Versions"=w79)
        Array Index(array=w79) -> (out0[w76]=w80)
        Property Node(instance in=w80) -> ("Version Text"=w81)
        call "Set Package.gvi"(Connection in=w69, Name=w78, Version=w81, error in=w70) -> (Connection out=w82, error out=w83)
        call "Close Connection.gvi"(Connection in=w82, error in=w83) -> (error out=w84)
        call "Redirect"(URL="PackageDetails.html", target="_blank", error in=w84) -> (error out=w85)
        call "UnsetBusy"(error in=w85) -> (error out=w14)
        w16 = default
      }
      frame "First" {
        Property Node(instance in=s1) -> ("Settings"=w86, instance out=w15)
        Property Node(instance in=w86, "PageNumber"=1) -> (instance out=w87)
        Flatten To JSON(anything=w87) -> (JSON string=w88)
        call "Enqueue Message (Single).gviweb"(message queue in=w10, message="List Packages", message data=w88, error in=w13) -> (error out=w14)
        w16 = default
      }
      frame "Last" {
        Property Node(instance in=s1) -> ("Settings"=w89, "List Details:TotalPages"=w90, instance out=w15)
        Property Node(instance in=w89, "PageNumber"=w90) -> (instance out=w91)
        Flatten To JSON(anything=w91) -> (JSON string=w92)
        call "Enqueue Message (Single).gviweb"(message queue in=w10, message="List Packages", message data=w92, error in=w13) -> (error out=w14)
        w16 = default
      }
      frame "Previous" {
        Property Node(instance in=s1) -> ("Settings"=w93, "Settings:PageNumber"=w94, instance out=w15)
        Decrement(x=w94) -> w95
        Property Node(instance in=w93, "PageNumber"=w95) -> (instance out=w96)
        Flatten To JSON(anything=w96) -> (JSON string=w97)
        call "Enqueue Message (Single).gviweb"(message queue in=w10, message="List Packages", message data=w97, error in=w13) -> (error out=w14)
        w16 = default
      }
      frame "Next" {
        Property Node(instance in=s1) -> ("Settings"=w98, "Settings:PageNumber"=w99, instance out=w15)
        Increment(x=w99) -> w100
        Property Node(instance in=w98, "PageNumber"=w100) -> (instance out=w101)
        Flatten To JSON(anything=w101) -> (JSON string=w102)
        call "Enqueue Message (Single).gviweb"(message queue in=w10, message="List Packages", message data=w102, error in=w13) -> (error out=w14)
        w16 = default
      }
      frame "Error" {
        # Process Error
        w103 = no error  # Error
        Unflatten From JSON(JSON string=w12, error in (no error)=w13, type and defaults=w103) -> (error out=w14, value=w104)
        call "Read Error Code.gvi"(error in=w104) -> (code=w105)
        case (w105) {
          frame 501401 {
            # Redirect to Login page
            call "Redirect"(URL="Login.html")
          }
          frame 0, Default {
            # Display Error
            call "Error Handler.gvi"(error in=w104)
          }
        }
        w15 = s1
        w16 = default
      }
      frame "---Copy This Frame---" {
        Merge Errors(w13) -> (error out=w14)
        w15 = s1
        w16 = default
      }
      frame "Exit" {
        # Release the message queue reference
        Release Queue(error in=w13, queue=w10) -> (error out=w106)
        Generate User Event(event data=TRUE, user event=w3) -> (error out=w107)
        Merge Errors(w107, w106) -> (error out=w14)
        # Stop the VI
        w15 = s1
        w16 = TRUE
      }
      frame Default {
        w108 = "The invalid message string \"%s\" was received in the Message Handling Loop."
        Format Into String(formatString=w108, w11) -> w109
        call "Build Error Cluster.gvi"(code=1, description=w109) -> (error out=w14)
        w15 = s1
        w16 = default
      }
    }
    call "Error Handler - Message Handling Loop.gviweb"(message queue in=w10, error in=w14) -> (dup error in=w110)
    next s1 = w15
    stop if w16
  }
  Register For Events("Stop Event"=w3) -> (event registration refnum out=w111)
  s2 = w111  # shift register
  while {
    event (dynamic events = s2) {
      on "Dynamic" Stop Event {
        # The Message Handling Loop processed an "Exit" message, which fired this event to stop the Event Handling Loop.
        w112 = TRUE
        w113 = no error
        w114 = w9
      }
      on "Tree" Selection changed {
        call "Enqueue Message (Single).gviweb"(message queue in=w9, message="Refresh Controls") -> (message queue out=w114, error out=w113)
        w112 = default
      }
      on "Search" Value changed {
        Event Data() -> ("New Value"=w115)
        w116 = "List Packages Settings--cluster.gtype" {"PageNumber"=1, "SearchCriteria"=""}
        Property Node(instance in=w116, "SearchCriteria"=w115, "PageNumber"=1) -> (instance out=w117)
        Flatten To JSON(anything=w117) -> (JSON string=w118)
        call "Enqueue Message (Single).gviweb"(message queue in=w9, message="List Packages", message data=w118) -> (message queue out=w114, error out=w113)
        w112 = default
      }
      on "First" Value changed {
        call "Enqueue Message (Single).gviweb"(message queue in=w9, message="First") -> (message queue out=w114, error out=w113)
        w112 = default
      }
      on "Last" Value changed {
        call "Enqueue Message (Single).gviweb"(message queue in=w9, message="Last") -> (message queue out=w114, error out=w113)
        w112 = default
      }
      on "Next" Value changed {
        call "Enqueue Message (Single).gviweb"(message queue in=w9, message="Next") -> (message queue out=w114, error out=w113)
        w112 = default
      }
      on "Previous" Value changed {
        call "Enqueue Message (Single).gviweb"(message queue in=w9, message="Previous") -> (message queue out=w114, error out=w113)
        w112 = default
      }
      on "Package Details" Value changed; "Package Details_2" Value changed {
        call "Enqueue Message (Single).gviweb"(message queue in=w9, message="Show Package Details") -> (message queue out=w114, error out=w113)
        w112 = default
      }
    }
    call "Error Handler - Event Handling Loop.gviweb"(message queue in=w114, error in=w113) -> (dup error in=w119)
    stop if w112
  }
  Unregister For Events(error in=w119, event registration refnum=s2) -> (error out=w120)
  Merge Errors(w120, w110) -> (error out=w121)
  Destroy User Event(error in=w121, user event=w3)
